# Dynamo graph BlocksHeight.dyn (Dynamo 2.1.0.7500)

select_model_elements = DSModelElementsSelection()  # 331 picked in the model
code_block = CodeBlock(x=select_model_elements) { x.Name; }
code_block_2 = CodeBlock { "Entourage 3"; }
eq = code_block == code_block_2
filterByBoolMask = List.FilterByBoolMask(list=select_model_elements, mask=eq)
flatten = List.Flatten(list=filterByBoolMask.in)
code_block_3 = CodeBlock { "Top Height"; "Top Bottom"; }

# group: Get centroids of selected buildings and project them to Z-0
geometry = Element.Geometry(element=flatten)
centroid = Solid.Centroid(solid=geometry)
X = Point.X(point=centroid)
Y = Point.Y(point=centroid)
code_block_4 = CodeBlock { 0; }
byCoordinates = Point.ByCoordinates(x=X, y=Y, z=code_block_4)
boolean = BoolSelector(true)
ꟿ_selectelementsinorder = Custom[ꟿ SelectElementsInOrder](refresh=boolean)  # frozen; Select multiple elements from the Revit document in the desired order. Hit ESC to stop picking. To refresh the node, connect a boolean switch node.

flatten_2 = List.Flatten(list=byCoordinates)

# group: Project the points to the toposurface
code_block_5 = CodeBlock { 100; }
translate = Geometry.Translate(geometry=flatten_2, zTranslation=code_block_5)
select_model_element = DSModelElementSelection()  # 1 picked in the model
mesh = Topography.Mesh(topography=select_model_element)
code_block_6 = CodeBlock { 16; }
ꟿ_mesh_topolysurface = Custom[ꟿ Mesh.ToPolySurface](mesh=mesh, NUMTHREADS=code_block_6)  # Converts a Dynamo mesh to a polysurface. By default the node is single threaded, but if you specify a higher number of threads in the `NUMTHREAD` input, the node will run multi-threaded to speed up the conversion. *WARNING* Using multi-threaded code with Dynamo's geometry kernel may crash Revit in some cases.
ZAxis = Vector.ZAxis()
reverse = Vector.Reverse(vector=ZAxis)
project = Point.Project(point=translate, baseGeometry=ꟿ_mesh_topolysurface, projectionDirection=reverse, lacing=Longest)

flatten_3 = List.Flatten(list=project)
distanceTo = Geometry.DistanceTo(geometry=flatten_2, other=flatten_3)
Z = Point.Z(point=project@L1)
code_block_7 = CodeBlock { 0; }
lt = Z < code_block_7
python_script = Python(IN[0]=distanceTo, IN[1]=lt)
# ---------- python_script.python (32 lines) ----------
# Load the Python Standard and DesignScript Libraries
import sys
import clr
clr.AddReference('ProtoGeometry')
from Autodesk.DesignScript.Geometry import *

# The inputs to this node will be stored as a list in the IN variables.
list0 = IN[0]
boolMask = IN[1]

testList1 = [0, 1, 2, 3, 4, 5, 6, 7, 8, 9, 10, 11, 12, 13, 14, 15, 16]

# Checking the boolean mask to replace values with their negative versions

i = 0

for item in list0:
	
	if boolMask[i] == True:
	
		list0[i] = list0[i] * -1
		
		i = i + 1
		
	else:
	
		i = i + 1
		
		continue

# Assign your output to the OUT variable.
OUT = list0
# ----------------------------------------
building_height_meters = DoubleInput(3)  # graph input
add = python_script + building_height_meters
setParameterByName = Element.SetParameterByName(element=flatten, parameterName=code_block_3.out0, value=add)
building_depth = DoubleInput(-2)
add_2 = python_script + building_depth
setParameterByName_2 = Element.SetParameterByName(element=flatten, parameterName=code_block_3.out1, value=add_2)
select_model_elements_2 = DSModelElementsSelection()  # 331 picked in the model; frozen
code_block_8 = CodeBlock(x=select_model_elements_2) { x.Name; }
code_block_9 = CodeBlock { "Entourage 3"; }
eq_2 = code_block_8 == code_block_9
filterByBoolMask_2 = List.FilterByBoolMask(list=select_model_elements_2, mask=eq_2)
flatten_4 = List.Flatten(list=filterByBoolMask_2.in)
code_block_10 = CodeBlock { "Top Height"; 1; "Top Bottom"; 0; }
setParameterByName_3 = Element.SetParameterByName(element=flatten_4, parameterName=code_block_10.out0, value=code_block_10.out1)
setParameterByName_4 = Element.SetParameterByName(element=flatten_4, parameterName=code_block_10.out2, value=code_block_10.out3)
