# Dynamo graph ConformPointsToTopo.dyn (Dynamo 2.3.0.5885)
# packages: spring nodes 204.1.0

select_topography = DSModelElementSelection()  # 1 picked in the model; graph input
points = Topography.Points(topography=select_topography)
select_lines = DSModelElementsSelection()  # 13 picked in the model; graph input
curves = Element.Curves(element=select_lines)
flatten = List.Flatten(list=curves)
code_block = CodeBlock { 0.01; }
code_block_2 = CodeBlock { 300; }
resolution_of_new_points_meters = DoubleSlider(1, range=0.5..4 step 0.1)  # graph input
sequence = Sequence(start=code_block, amount=code_block_2, step=resolution_of_new_points_meters)
pointAtSegmentLength = Curve.PointAtSegmentLength(curve=flatten@L1, segmentLength=sequence)
flatten_2 = List.Flatten(list=pointAtSegmentLength)
mesh = Topography.Mesh(topography=select_topography)
code_block_3 = CodeBlock { 16; }
ꟿ_mesh_topolysurface = Custom[ꟿ Mesh.ToPolySurface](mesh=mesh, NUMTHREADS=code_block_3)  # package spring nodes; Converts a Dynamo mesh to a polysurface. By default the node is single threaded, but if you specify a higher number of threads in the `NUMTHREAD` input, the node will run multi-threaded to speed up the conversion. *WARNING* Using multi-threaded code with Dynamo's geometry kernel may crash Revit in some cases.
ZAxis = Vector.ZAxis()
reverse = Vector.Reverse(vector=ZAxis)
project = Point.Project(point=flatten_2, baseGeometry=ꟿ_mesh_topolysurface, projectionDirection=reverse, lacing=Longest)
flatten_3 = List.Flatten(list=project)
join = List.Join(list0=points, list1=flatten_3)
code_block_4 = CodeBlock { false; }
ꟿ_points_pruneduplicates = Custom[ꟿ Points.PruneDuplicates+](points=join, keepDuplicateZ=code_block_4)  # package spring nodes; An alternative to the built in node, that performs faster at the price of loosing the order of the points. All floating point valies are rounded to the nearest 4 decimal points. You can optionally remove duplicate Z values by setting "keepDuplicateZ" to false.
byPoints = Topography.ByPoints(points=ꟿ_points_pruneduplicates)
