# Dynamo graph CropRegionByDetailLines.dyn (Dynamo 2.3.0.5885)
# packages: bimorphNodes 3.0.3, archi-lab.net 2021.25.2621

allAttributes = Revit.LineStyle.AllAttributes()
select_area_to_crop_must_have = DSModelElementsSelection()  # "Select Area to Crop (Must have <Centerline> Detail Lines as the intended boundary)"; 262 picked in the model; graph input
name = Element.Name(element=select_area_to_crop_must_have)
code_block = CodeBlock { "Detail Lines"; }
eq = name == code_block
filterByBoolMask = List.FilterByBoolMask(list=select_area_to_crop_must_have, mask=eq)
watch = Watch(filterByBoolMask.in)
python_script = Python(IN[0]=watch)
# ---------- python_script.python (51 lines) ----------
""" Ricardo Salas' Template """

import clr

clr.AddReference('RevitAPI')
from Autodesk.Revit.DB import *
from Autodesk.Revit.DB.Structure import *

clr.AddReference('RevitAPIUI')
from Autodesk.Revit.UI import *

clr.AddReference('System')
from System.Collections.Generic import List

clr.AddReference('RevitNodes')
import Revit
clr.ImportExtensions(Revit.GeometryConversion)
clr.ImportExtensions(Revit.Elements)

clr.AddReference('RevitServices')
import RevitServices
from RevitServices.Persistence import DocumentManager
from RevitServices.Transactions import TransactionManager

doc = DocumentManager.Instance.CurrentDBDocument
uidoc=DocumentManager.Instance.CurrentUIApplication.ActiveUIDocument

#Preparing input from dynamo to revit
element = UnwrapElement(IN[0])

styles = []

for i in element:

	# Gets linestyle of the current line
	lineStyle = str(i.LineStyle.Name)
	
	if lineStyle == "<Centerline>":
	
		styles.append(i)
		
	else:
	
		continue

#Do some action in a Transaction
TransactionManager.Instance.EnsureInTransaction(doc)

TransactionManager.Instance.TransactionTaskDone()

OUT = styles
# ----------------------------------------
curve = DetailCurve.Curve(detailCurve=python_script)
join = Curve.Join(curve=curve)  # unwired: curves
current = Document.Current()
activeView = Document.ActiveView(document=current)
byJoinedCurves = PolyCurve.ByJoinedCurves(curves=curve)
code_block_2 = CodeBlock { 304.8; }
offset = Curve.Offset(curve=byJoinedCurves, distance=code_block_2)
explode = Geometry.Explode(geometry=offset)
byGeometry = BoundingBox.ByGeometry(geom=explode)
setCropBox = archilab.Revit.Views.Views.SetCropBox(view=activeView, boundingBox=byGeometry)
code_block_3 = CodeBlock { "Crop Region Visible"; 0; }
setParameterByName = Element.SetParameterByName(element=setCropBox, parameterName=code_block_3.out0, value=code_block_3.out1)
