# Dynamo custom node Rhythm.WhatTheNode.dyf (Dynamo 2.0.3.8810)
# category: Rhythm.Tools
# This node will let you search dynamonodes.com for the most likely package a node is from. Helps fix "red" nodes when users do not have package installed.

string = StringInput("Node has been retired! Use Monocle package to find what node came from where. Video Below:")
monocle_overview = CodeBlock { "https://www.youtube.com/watch?v=AYfAYHQmdTA&feature=youtu.be"; }
list_create = List.Create(item0=string, item1=monocle_overview)
likelyPackage = Output(list_create)
