# Dynamo graph Sheet Count.dyn (Dynamo 2.3.0.5885)

categories = Categories("OST_Sheets")  # graph input
all_elements_of_category = ElementsOfCategory(Category=categories)

# group: Exclude first sheet if it is 000
sheetNumber = Sheet.SheetNumber(sheet=all_elements_of_category)
firstItem = List.FirstItem(list=sheetNumber)
code_block = CodeBlock { "000"; }
restOfItems = List.RestOfItems(list=all_elements_of_category)
sheetNumber_2 = Sheet.SheetNumber(sheet=restOfItems)

watch = Watch(firstItem)

# group (continued): Exclude first sheet if it is 000
eq = watch == code_block
if_ = If(test=eq, true=restOfItems, false=all_elements_of_category)

sheetNumber_3 = Sheet.SheetNumber()  # unwired: sheet
sortByFunction = List.SortByFunction(list=if_, func=sheetNumber_3)
sortByFunction_2 = List.SortByFunction(list=all_elements_of_category, func=sheetNumber_3)
sheetNumber_4 = Sheet.SheetNumber(sheet=all_elements_of_category)
code_block_2 = CodeBlock { "000"; }
eq_2 = sheetNumber_4 == code_block_2
filterByBoolMask = List.FilterByBoolMask(list=all_elements_of_category, mask=eq_2)
watch_2 = Watch(filterByBoolMask.out)
code_block_3 = CodeBlock { "Number of Sheet"; "Total Sheet Quantity"; }
code_block_4 = CodeBlock { 1; 1; }
count = List.Count(list=watch_2)
range = Range(start=code_block_4.out0, end=count, step=code_block_4.out1)
setParameterByName = Element.SetParameterByName(element=watch_2, parameterName=code_block_3.out0, value=range)
categories_2 = Categories("OST_ProjectInformation")  # graph input
all_elements_of_category_2 = ElementsOfCategory(Category=categories_2)
setParameterByName_2 = Element.SetParameterByName(element=all_elements_of_category_2, parameterName=code_block_3.out1, value=count)
