# Dynamo graph Sheet Numbering.dyn (Dynamo 2.3.0.5885)

categories = Categories("OST_Sheets")  # graph input
all_elements_of_category = ElementsOfCategory(Category=categories)
sheetNumber = Sheet.SheetNumber()  # unwired: sheet
sortByFunction = List.SortByFunction(list=all_elements_of_category, func=sheetNumber)
sheetNumber_2 = Sheet.SheetNumber(sheet=sortByFunction)
firstItem = List.FirstItem(list=sheetNumber_2)
code_block = CodeBlock { "000"; }
eq = firstItem == code_block
restOfItems = List.RestOfItems(list=sortByFunction)
if_ = If(test=eq, true=restOfItems, false=all_elements_of_category)
sortByFunction_2 = List.SortByFunction(list=if_, func=sheetNumber)
sheetNumber_3 = Sheet.SheetNumber(sheet=sortByFunction_2)
code_block_2 = CodeBlock { ["A", "G", "S", "L", "I", "V", "B", "E"]; }
startsWith = String.StartsWith(searchFor=code_block_2)  # unwired: str
map = List.Map(list=sheetNumber_3, f_x=startsWith)
code_block_3 = CodeBlock { true; }
allIndicesOf = List.AllIndicesOf(item=code_block_3)  # unwired: list
map_2 = List.Map(list=map, f_x=allIndicesOf)
watch = Watch(map_2)
flatten = List.Flatten(list=watch)
groupByKey = List.GroupByKey(list=sortByFunction_2, keys=flatten)
watch_2 = Watch(groupByKey.unique_keys)
code_block_4 = CodeBlock { ["B"]; }
join = List.Join(list0=code_block_2, list1=code_block_4)
code_block_5 = CodeBlock { 0; 3; }
substring = String.Substring(str=sheetNumber_3, startIndex=code_block_5.out0, length=code_block_5.out1)
countOccurrences = String.CountOccurrences(searchFor=code_block_2)  # unwired: str
map_3 = List.Map(list=substring, f_x=countOccurrences)
sum = Math.Sum(values=map_3)
watch_3 = Watch(groupByKey.groups)
code_block_6 = CodeBlock { "Sheet Number"; }
sheetNumber_4 = Sheet.SheetNumber(sheet=watch_3)
code_block_7 = CodeBlock { 0; 1; }
substring_2 = String.Substring(str=sheetNumber_4, startIndex=code_block_7.out0, length=code_block_7.out1)
code_block_8 = CodeBlock { 101..200..1; 1; 0; }
string_from_object = FromObject(obj=code_block_8.out2)
insert = String.Insert(index=code_block_8.out1, toInsert=string_from_object)  # unwired: str
map_4 = List.Map(list=substring_2, f_x=insert)
string_from_object_2 = FromObject(obj=code_block_8.out0)
transpose = List.Transpose(lists=string_from_object_2)
insert_2 = String.Insert(index=code_block_8.out1, toInsert=transpose)  # unwired: str
map_5 = List.Map(list=map_4, f_x=insert_2)
setParameterByName = Element.SetParameterByName(element=watch_3, parameterName=code_block_6, value=map_5)
map_6 = List.Map(list=substring_2, f_x=insert_2)
setParameterByName_2 = Element.SetParameterByName(element=setParameterByName, parameterName=code_block_6, value=map_6)
sheetNumber_5 = Sheet.SheetNumber(sheet=restOfItems)
watch_4 = Watch(firstItem)
