# Dynamo graph TopoToObject.dyn (Dynamo 2.3.0.5885)
# packages: spring nodes 204.1.0

select_topography = DSModelElementSelection()  # 1 picked in the model; graph input
points = Topography.Points(topography=select_topography)
select_faces_of_objects = SelectFaces()  # 1 picked in the model; graph input
edges = Topology.Edges(topology=select_faces_of_objects)
curveGeometry = Edge.CurveGeometry(edge=edges)
code_block = CodeBlock { 0.01; }
code_block_2 = CodeBlock { 300; }
resolution_of_new_points_meters = DoubleSlider(1, range=0.5..4 step 0.1)  # graph input
sequence = Sequence(start=code_block, amount=code_block_2, step=resolution_of_new_points_meters)
pointAtSegmentLength = Curve.PointAtSegmentLength(curve=curveGeometry@L1, segmentLength=sequence)
flatten = List.Flatten(list=pointAtSegmentLength)
join = List.Join(list0=points, list1=flatten)
code_block_3 = CodeBlock { false; }
ꟿ_points_pruneduplicates = Custom[ꟿ Points.PruneDuplicates+](points=join, keepDuplicateZ=code_block_3)  # package spring nodes
byPoints = Topography.ByPoints(points=ꟿ_points_pruneduplicates)
code_block_4 = CodeBlock { 0.01..0.99..0.05; }
pointAtParameter = Surface.PointAtParameter(surface=select_faces_of_objects, u=code_block_4, v=code_block_4, lacing=CrossProduct)  # frozen
flatten_2 = List.Flatten(list=select_faces_of_objects)  # frozen
distanceTo = Geometry.DistanceTo(geometry=flatten_2, other=pointAtParameter)
code_block_5 = CodeBlock { 0; }
eq = distanceTo == code_block_5
filterByBoolMask = List.FilterByBoolMask(list=pointAtParameter, mask=eq)
flatten_3 = List.Flatten(list=filterByBoolMask.in)
